# Dynamo graph Stairs QTO.dyn (Dynamo 2.6.1.8786)

categories = Categories("OST_Stairs")
all_elements_of_category = ElementsOfCategory(Category=categories)
geometry = Element.Geometry(element=all_elements_of_category)
volume = Solid.Volume(solid=geometry)
sum = Math.Sum(values=volume)
volume_2 = Watch(sum)  # graph output
explode = Geometry.Explode(geometry=geometry)
area = Surface.Area(surface=explode)
sum_2 = Math.Sum(values=area)
sum_3 = Math.Sum(values=sum_2)
total_area = Watch(sum_3)  # graph output
code_block = CodeBlock { 0.5; }
normalAtParameter = Surface.NormalAtParameter(surface=explode, u=code_block, v=code_block)
X = Vector.X(vector=normalAtParameter)
round = Math.Round(number=X)
Y = Vector.Y(vector=normalAtParameter)
round_2 = Math.Round(number=Y)
Z = Vector.Z(vector=normalAtParameter)
round_3 = Math.Round(number=Z)
byCoordinates = Vector.ByCoordinates(x=round, y=round_2, z=round_3)
code_block_2 = CodeBlock { 1; }
byCoordinates_2 = Vector.ByCoordinates(x=code_block_2)
code_block_3 = CodeBlock { 1; }
byCoordinates_3 = Vector.ByCoordinates(y=code_block_3)
code_block_4 = CodeBlock { 1; }
byCoordinates_4 = Vector.ByCoordinates(z=code_block_4)
list_create = List.Create(item0=byCoordinates_2, item1=byCoordinates_3, item2=byCoordinates_4)
isParallel = Vector.IsParallel(vector=byCoordinates, other=list_create@@L1, lacing=CrossProduct)
filterByBoolMask = List.FilterByBoolMask(list=explode, mask=isParallel@@L3, lacing=CrossProduct)
code_block_5 = CodeBlock(x=filterByBoolMask.in) { x[0][0]; x[0][1]; x[0][2]; }
list_create_2 = List.Create(item0=code_block_5.out0, item1=code_block_5.out1)
flatten = List.Flatten(list=list_create_2)
area_2 = Surface.Area(surface=flatten)
python_script = Python(IN[0]=area_2)
# ---------- python_script.python (19 lines) ----------
# Load the Python Standard and DesignScript Libraries
import sys
import clr
clr.AddReference('ProtoGeometry')
from Autodesk.DesignScript.Geometry import *
from collections import Counter

# The inputs to this node will be stored as a list in the IN variables.
dataEnteringNode = IN

# Place your code below this line



c = Counter(IN[0])
x = c.most_common(1)[0][0]

# Assign your output to the OUT variable.
OUT = x
# ----------------------------------------
code_block_6 = CodeBlock(x=area_2, y=python_script) { x==y; }
filterByBoolMask_2 = List.FilterByBoolMask(list=flatten, mask=code_block_6)
area_3 = Surface.Area(surface=filterByBoolMask_2.in)
sum_4 = Math.Sum(values=area_3)
list_create_3 = List.Create(item0=code_block_5.out2)
lastItem = List.LastItem(list=list_create_3@L2)
code_block_7 = CodeBlock { 2; }
removeItemAtIndex = List.RemoveItemAtIndex(list=lastItem, indices=code_block_7)
setDifference = List.SetDifference(list1=list_create_3, list2=removeItemAtIndex)
flatten_2 = List.Flatten(list=setDifference)
area_4 = Surface.Area(surface=flatten_2)
sum_5 = Math.Sum(values=area_4)
list_create_4 = List.Create(item0=sum_4, item1=sum_5)
sum_6 = Math.Sum(values=list_create_4)
ceramic_area = Watch(sum_6)  # graph output
sub = sum_3 - sum_6
paint_area = Watch(sub)  # graph output
